% Simulink data dictionary datadict_clutch.sldd

f1 = Simulink.Parameter([1; 6; 11; 16; 21; 26; 31; 36; 41; 46; 51], DataType="double")
bv = Simulink.Parameter(1, DataType="double")
muk = Simulink.Parameter(1, DataType="double")
mus = Simulink.Parameter(1.5, DataType="double")
be = Simulink.Parameter(2, DataType="double")

Tin = Simulink.Parameter([1 2
 2 2
 3 2
 4 2
 5 2
 6 0
 7 0
 8 0
 9 0
 10 0], DataType="double")

R = Simulink.Parameter(1, DataType="double")
Iv = Simulink.Parameter(5, DataType="double")
Ie = Simulink.Parameter(1, DataType="double")

Fn = Simulink.Parameter([0 0
 1 0.8
 2 1.6
 3 1.6
 4 1.6
 5 1.6
 6 0.8
 7 0
 8 0
 9 0
 10 0], DataType="double")